vi "BPSK reciver.gvi"   [LabVIEW Communications System Design Suite 2.0.1]
panel controls:
  "IQ rate": f64 = 200000
  "device names": "niUSRPClass"
  "carrier frequency": f64 = 400000000
  "gain Tx": f64
  "active antenna Tx": string = "TX1"
  "stop Tx": bool
  "gain Rx": f64
  "active antenna Rx": string = "RX2"
  "total bits": i32 = 128
  "Symbol Rate": f64
panel indicators:
  "Baseband Power Spectrum": T1
  "upsampling factor L": f64
  "Baseband_Waveform": waveform<c128>
  "Output Bits": i16[]
  "BER": f64
  "trigger found?": bool
types:
  T1 = cluster{"f0": f64, "df": f64, "magnitude": f64[]}
uses:
  NI::Analysis::Resampling::Upsample (DBL).gvi
  NI::Analysis::Operations::1D Convolution (DBL).gvi
  NI::Analysis::Operations::1D Convolution (CDB).gvi
  NI::Analysis::Resampling::Decimate (single shot, CDB).gvi
diagram:
  Reciprocal(x=$"IQ rate") -> w1
  w2 = $"total bits"
  call "MT Generate Bits (Fibonacci, PN Order).gvi"(total bits=w2) -> (output bit stream=w3)
  for (N = w2) {
    w4 = each element of w3
    Is Equal To 0(x=w4) -> w6
    Select(s=w6, t=-1, f=w4) -> w7
    append w7 to w5
  }
  call "AddFrameHeader.gvi"(array=w5) -> (output array=w8)
  Divide(x=$"IQ rate", y=$"Symbol Rate") -> w9
  call "Upsample (DBL).gvi"(input array=w8, upsampling factor=w9) -> (upsampled array=w10)
  call "MT Generate Filter Coefficients.gvi"(pulse shaping filter="Root Raised Cos", pulse shaping samples per symbol=w9, modulation type="PSK") -> (pulse shaping filter coefficients=w11)
  call "1D Convolution (DBL).gvi"(x=w10, y=w11) -> (x * y=w12)
  call "Quick Scale 1D.gvi"(X=w12) -> (Y[i]=X[i]/Max|X|=w13)
  Real And Imaginary To Complex(x=w13, y=0) -> w14
  call "Insert Pilots.gvi"(signal input=w14) -> (output signal=w15)
  call "AddFrameHeader (complex).gvi"(array=w15) -> (output array=w16)
  Build Waveform Node(Y=w16, dt=w1) -> (output waveform=w17)
  $Baseband_Waveform <- w17
  $"upsampling factor L" <- w9
  w18 = cluster{"t0": timestamp, "dt": f64, "Y": c128[]} {all zero or empty}
  Property Node(instance in=w18, "dt"=w1, "Y"=w16) -> (instance out=w19)
  call "FFT Power Spectrum for 1 Chan (CDB)2.gvi"(time signal=w19, dB On (F)=TRUE) -> (power spectrum=w20)
  $"Baseband Power Spectrum" <- w20
  call "niUSRP Open Rx Session.gvi"(device names=$"device names") -> (error out=w21, session handle out=w22)
  call "niUSRP Configure Signal.gvi"(session handle=w22, IQ rate=$"IQ rate", carrier frequency=$"carrier frequency", gain=$"gain Rx", error in=w21, active antenna=$"active antenna Rx") -> (session handle out=w23, coerced carrier frequency=w24, error out=w25)
  Subtract(x=w24, y=20000) -> w26
  Property Node(instance in=w23, "LO Frequency"=w26) -> (instance out=w27)
  call "niUSRP Initiate.gvi"(session handle=w27, error in=w25) -> (session handle out=w28, error out=w29)
  call "niUSRP Fetch Rx Data (CDB).gvi"(session handle=w28, number of samples=40, error in=w29) -> (session handle out=w30, data=w31, error out=w32)
  call "niUSRP Close Session.gvi"(session handle=w30, error in=w32)
  call "FrameSync.gvi"(Sampled Input=w31) -> (Aligned Samples=w33)
  call "Channel Estimator.gvi"(input signal=w33)
  call "niUSRP Open Tx Session.gvi"(device names=$"device names") -> (session handle out=w34, error out=w35)
  call "niUSRP Configure Signal.gvi"(session handle=w34, IQ rate=$"IQ rate", carrier frequency=$"carrier frequency", gain=$"gain Tx", error in=w35, active antenna=$"active antenna Tx") -> (session handle out=w36, error out=w37)
  while {
    call "niUSRP Write Tx Data (CDB).gvi"(session handle=w36, data=w16, error in=w37) -> (session handle out=w38, error out=w39)
    stop if $"stop Tx"
  }
  call "niUSRP Close Session.gvi"(session handle=w38, error in=w39)
  call "MT Generate Filter Coefficients.gvi"(pulse shaping filter="Root Raised Cos", matched samples per symbol=w9, modulation type="PSK") -> (matched filter coefficients=w40)
  call "1D Convolution (CDB).gvi"(x=w33, y=w40)
  call "PulseAlign.gvi"(Input signal=w17, Receiver Sampling Factor=w9)
  call "Decimate (single shot, CDB).gvi"(decimating factor=w9) -> (decimated array=w41)
  call "FrameSync.gvi"(Sampled Input=w41) -> (Aligned Samples=w42)
  Is Equal To 0(x=w42) -> w43
  Boolean To Integer(Boolean=w43) -> (0, 1=w44)
  Array Subset(array=w44, index0=0, length0=w2) -> w45
  $"Output Bits" <- w45
  call "MT Calculate BER After Trigger (Fibonacci PN Sequence).gvi"(input bit stream=w45, BER trigger threshold=0.4) -> (BER=w46, trigger found?=w47)
  $BER <- w46
  $"trigger found?" <- w47
