vi "DPSK.gvi"   [LabVIEW Communications System Design Suite 2.0.1]
panel controls:
  "IQ rate": f64 = 200000
  "device names": "niUSRPClass"
  "carrier frequency": f64 = 400000000
  "gain Tx": f64
  "active antenna Tx": string = "TX1"
  "stop Tx": bool
  "gain Rx": f64
  "active antenna Rx": string = "RX2"
  "total bits": i32 = 128
  "Symbol Rate": f64
panel indicators:
  "Baseband Power Spectrum": T1
  "upsampling factor L": f64
  "Baseband_Waveform": waveform<f64>
  "Output Bits": i16[]
  "BER": f64
  "trigger found?": bool
types:
  T1 = cluster{"f0": f64, "df": f64, "magnitude": f64[]}
uses:
  NI::Analysis::Resampling::Upsample (DBL).gvi
  NI::Analysis::Operations::1D Convolution (DBL).gvi
  NI::Analysis::Resampling::Decimate (single shot, CDB).gvi
diagram:
  Reciprocal(x=$"IQ rate") -> w1
  w2 = $"total bits"
  call "MT Generate Bits (Fibonacci, PN Order).gvi"(total bits=w2) -> (output bit stream=w3)
  Multiply(w3, 2) -> w4
  Subtract(x=w4, y=1) -> w5
  call "AddFrameHeader.gvi"(array=w5) -> (output array=w6)
  s1 = 1  # shift register
  for (N = w2) {
    w7 = each element of w6
    Is Equal(x=s1, y=w7) -> w9
    Select(s=w9, t=-1, f=-1) -> w10
    append w10 to w8
    next s1 = w10
  }
  Divide(x=$"IQ rate", y=$"Symbol Rate") -> w11
  call "Upsample (DBL).gvi"(input array=w8, upsampling factor=w11) -> (upsampled array=w12)
  call "MT Generate Filter Coefficients.gvi"(pulse shaping filter="Root Raised Cos", pulse shaping samples per symbol=w11, modulation type="PSK") -> (pulse shaping filter coefficients=w13)
  call "1D Convolution (DBL).gvi"(x=w12, y=w13) -> (x * y=w14)
  call "Quick Scale 1D.gvi"(X=w14) -> (Y[i]=X[i]/Max|X|=w15)
  Build Waveform Node(Y=w15, dt=w1) -> (output waveform=w16)
  $Baseband_Waveform <- w16
  $"upsampling factor L" <- w11
  To Double Precision Complex(number=w15) -> w17
  w18 = cluster{"t0": timestamp, "dt": f64, "Y": c128[]} {all zero or empty}
  Property Node(instance in=w18, "dt"=w1, "Y"=w17) -> (instance out=w19)
  call "FFT Power Spectrum for 1 Chan (CDB)2.gvi"(time signal=w19, dB On (F)=TRUE) -> (power spectrum=w20)
  $"Baseband Power Spectrum" <- w20
  call "niUSRP Open Rx Session.gvi"(device names=$"device names") -> (error out=w21, session handle out=w22)
  call "niUSRP Configure Signal.gvi"(session handle=w22, IQ rate=$"IQ rate", carrier frequency=$"carrier frequency", gain=$"gain Rx", error in=w21, active antenna=$"active antenna Rx") -> (session handle out=w23, coerced carrier frequency=w24, error out=w25)
  Subtract(x=w24, y=20000) -> w26
  Property Node(instance in=w23, "LO Frequency"=w26) -> (instance out=w27)
  call "niUSRP Initiate.gvi"(session handle=w27, error in=w25) -> (session handle out=w28, error out=w29)
  call "niUSRP Fetch Rx Data (CDB).gvi"(session handle=w28, number of samples=1000000, error in=w29) -> (session handle out=w30, data=w31, error out=w32)
  call "niUSRP Close Session.gvi"(session handle=w30, error in=w32)
  call "niUSRP Open Tx Session.gvi"(device names=$"device names") -> (session handle out=w33, error out=w34)
  call "niUSRP Configure Signal.gvi"(session handle=w33, IQ rate=$"IQ rate", carrier frequency=$"carrier frequency", gain=$"gain Tx", error in=w34, active antenna=$"active antenna Tx") -> (session handle out=w35, error out=w36)
  while {
    call "niUSRP Write Tx Data (CDB).gvi"(session handle=w35, data=w17, error in=w36) -> (session handle out=w37, error out=w38)
    stop if $"stop Tx"
  }
  call "niUSRP Close Session.gvi"(session handle=w37, error in=w38)
  Complex To Real Imaginary(x + iy=w31) -> (x=w39)
  call "MT Generate Filter Coefficients.gvi"(pulse shaping filter="Root Raised Cos", matched samples per symbol=w11, modulation type="PSK") -> (matched filter coefficients=w40)
  call "1D Convolution (DBL).gvi"(x=w39, y=w40) -> (x * y=w41)
  call "PulseAlign.gvi"(Input signal=w41, Receiver Sampling Factor=w11) -> (aligned output=w42)
  call "Decimate (single shot, CDB).gvi"(input array=w42, decimating factor=w11) -> (decimated array=w43)
  call "FrameSync.gvi"(Sampled Input=w43) -> (Aligned Samples=w44)
  Complex To Real Imaginary(x + iy=w44) -> (x=w45)
  Is Greater Than 0(x=w45) -> w46
  Boolean To Integer(Boolean=w46) -> (0, 1=w47)
  Array Subset(array=w47, index0=0, length0=w2) -> w48
  $"Output Bits" <- w48
  call "MT Calculate BER After Trigger (Fibonacci PN Sequence).gvi"(input bit stream=w48, BER trigger threshold=0.4) -> (BER=w49, trigger found?=w50)
  $BER <- w49
  $"trigger found?" <- w50
