vi "Error Correction Coding.gvi"   [LabVIEW Communications System Design Suite 2.0.1]
panel controls:
  "IQ rate": f64 = 200000
  "device names": "niUSRPClass"
  "carrier frequency": f64 = 400000000
  "gain Tx": f64
  "active antenna Tx": string = "TX1"
  "stop Tx": bool
  "gain Rx": f64
  "active antenna Rx": string = "RX2"
  "total bits": i32 = 128
  "Symbol Rate": f64
panel indicators:
  "Baseband Power Spectrum": T1
  "upsampling factor L": f64
  "Baseband_Waveform": waveform<f64>
  "Output Bits": i16[]
  "BER": f64
types:
  T1 = cluster{"f0": f64, "df": f64, "magnitude": f64[]}
uses:
  NI::Analysis::Resampling::Upsample (DBL).gvi
  NI::Analysis::Operations::1D Convolution (DBL).gvi
  NI::Analysis::Resampling::Decimate (single shot, CDB).gvi
diagram:
  Reciprocal(x=$"IQ rate") -> w1
  w2 = $"total bits"
  call "MT Generate Bits (Fibonacci, PN Order).gvi"(total bits=w2) -> (output bit stream=w3)
  Build Array[ConcatenateInputs=True](w3, w3, w3) -> w4
  for (N = w2) {
    w5 = each element of w4
    Is Equal To 0(x=w5) -> w7
    Select(s=w7, t=-1, f=1) -> w8
    append w8 to w6
  }
  call "AddFrameHeader.gvi"(array=w6) -> (output array=w9)
  Divide(x=$"IQ rate", y=$"Symbol Rate") -> w10
  call "Upsample (DBL).gvi"(input array=w9, upsampling factor=w10) -> (upsampled array=w11)
  call "MT Generate Filter Coefficients.gvi"(pulse shaping filter="Root Raised Cos", pulse shaping samples per symbol=w10, modulation type="PSK") -> (pulse shaping filter coefficients=w12)
  call "1D Convolution (DBL).gvi"(x=w11, y=w12) -> (x * y=w13)
  call "Quick Scale 1D.gvi"(X=w13) -> (Y[i]=X[i]/Max|X|=w14)
  Build Waveform Node(Y=w14, dt=w1) -> (output waveform=w15)
  $Baseband_Waveform <- w15
  $"upsampling factor L" <- w10
  w16 = cluster{"t0": timestamp, "dt": f64, "Y": c128[]} {all zero or empty}
  Property Node(instance in=w16, "dt"=w1, "Y"=w14) -> (instance out=w17)
  call "FFT Power Spectrum for 1 Chan (CDB)2.gvi"(time signal=w17, dB On (F)=TRUE) -> (power spectrum=w18)
  $"Baseband Power Spectrum" <- w18
  call "niUSRP Open Rx Session.gvi"(device names=$"device names") -> (error out=w19, session handle out=w20)
  call "niUSRP Configure Signal.gvi"(session handle=w20, IQ rate=$"IQ rate", carrier frequency=$"carrier frequency", gain=$"gain Rx", error in=w19, active antenna=$"active antenna Rx") -> (session handle out=w21, coerced carrier frequency=w22, error out=w23)
  Subtract(x=w22, y=20000) -> w24
  Property Node(instance in=w21, "LO Frequency"=w24) -> (instance out=w25)
  call "niUSRP Initiate.gvi"(session handle=w25, error in=w23) -> (session handle out=w26, error out=w27)
  call "niUSRP Fetch Rx Data (CDB).gvi"(session handle=w26, number of samples=1000000, error in=w27) -> (session handle out=w28, data=w29, error out=w30)
  call "niUSRP Close Session.gvi"(session handle=w28, error in=w30)
  call "niUSRP Open Tx Session.gvi"(device names=$"device names") -> (session handle out=w31, error out=w32)
  call "niUSRP Configure Signal.gvi"(session handle=w31, IQ rate=$"IQ rate", carrier frequency=$"carrier frequency", gain=$"gain Tx", error in=w32, active antenna=$"active antenna Tx") -> (session handle out=w33, error out=w34)
  To Double Precision Complex(number=w14) -> w35
  call "Insert Pilots.gvi"(signal input=w35) -> (output signal=w36)
  call "AddFrameHeader (complex).gvi"(array=w36) -> (output array=w37)
  while {
    call "niUSRP Write Tx Data (CDB).gvi"(session handle=w33, data=w37, error in=w34) -> (session handle out=w38, error out=w39)
    stop if $"stop Tx"
  }
  call "niUSRP Close Session.gvi"(session handle=w38, error in=w39)
  Multiply(3, w2) -> w40
  call "FrameSync.gvi"(Sampled Input=w29) -> (Aligned Samples=w41)
  call "Channel Estimator.gvi"(input signal=w41) -> (signal out=w42)
  Complex To Real Imaginary(x + iy=w42) -> (x=w43)
  call "MT Generate Filter Coefficients.gvi"(pulse shaping filter="Root Raised Cos", matched samples per symbol=w10, modulation type="PSK") -> (matched filter coefficients=w44)
  call "1D Convolution (DBL).gvi"(x=w43, y=w44) -> (x * y=w45)
  call "PulseAlign.gvi"(Input signal=w45, Receiver Sampling Factor=w10) -> (aligned output=w46)
  call "Decimate (single shot, CDB).gvi"(input array=w46, decimating factor=w10) -> (decimated array=w47)
  call "FrameSync.gvi"(Sampled Input=w47) -> (Aligned Samples=w48)
  Complex To Real Imaginary(x + iy=w48) -> (x=w49)
  Is Greater Than 0(x=w49) -> w50
  Boolean To Integer(Boolean=w50) -> (0, 1=w51)
  Array Subset(array=w51, index0=0, length0=w40) -> w52
  call "FEC Decoder.gvi"(data_in=w52) -> (output=w53)
  call "BER.gvi"(transmitted bits=w52, received bits=w53) -> (BER=w54)
  $BER <- w54
  $"Output Bits" <- w52
