vi "BPSK_Tx_Rx_Template.gvi"   [LabVIEW Communications System Design Suite 2.0.1]
panel controls:
  "IQ rate": f64 = 200000
  "device names": "niUSRPClass"
  "carrier frequency": f64 = 400000000
  "gain Tx": f64
  "active antenna Tx": string = "TX1"
  "stop Tx": bool
  "gain Rx": f64
  "active antenna Rx": string = "RX2"
  "total bits": i32 = 128
panel indicators:
  "Baseband Waveform": waveform<f64>
  "Baseband Power Spectrum": T1
  "Baseband Output": cluster{"t0": f64, "dt": f64, "Y": f64[]}
types:
  T1 = cluster{"f0": f64, "df": f64, "magnitude": f64[]}
diagram:
  w1 = cluster{"t0": f64, "dt": f64, "Y": f64[]} {all zero or empty}
  Property Node(instance in=w1) -> (instance out=w2)  # Cluster Properties
  $"Baseband Output" <- w2
  Build Waveform Node() -> (output waveform=w3)
  $"Baseband Waveform" <- w3
  w4 = cluster{"t0": timestamp, "dt": f64, "Y": c128[]} {all zero or empty}
  Property Node(instance in=w4) -> (instance out=w5)
  call "FFT Power Spectrum for 1 Chan (CDB)2.gvi"(time signal=w5, dB On (F)=TRUE) -> (power spectrum=w6)
  $"Baseband Power Spectrum" <- w6
  call "niUSRP Open Rx Session.gvi"(device names=$"device names") -> (error out=w7, session handle out=w8)
  call "niUSRP Configure Signal.gvi"(session handle=w8, IQ rate=$"IQ rate", carrier frequency=$"carrier frequency", gain=$"gain Rx", error in=w7, active antenna=$"active antenna Rx") -> (session handle out=w9, coerced carrier frequency=w10, error out=w11)
  Subtract(x=w10, y=20000) -> w12
  Property Node(instance in=w9, "LO Frequency"=w12) -> (instance out=w13)
  call "niUSRP Initiate.gvi"(session handle=w13, error in=w11) -> (session handle out=w14, error out=w15)
  call "niUSRP Fetch Rx Data (CDB).gvi"(session handle=w14, number of samples=1000000, error in=w15) -> (session handle out=w16, error out=w17)
  call "niUSRP Close Session.gvi"(session handle=w16, error in=w17)
  w18 = $"total bits"
  call "MT Generate Bits (Fibonacci, PN Order).gvi"(total bits=w18) -> (output bit stream=w19)
  for (N = w18) {
    w20 = each element of w19
    Is Equal To 0(x=w20) -> w22
    Select(s=w22, t=-1, f=w20) -> w23
    Real And Imaginary To Complex(x=w23, y=0) -> w24
    append w24 to w21
  }
  call "niUSRP Open Tx Session.gvi"(device names=$"device names") -> (session handle out=w25, error out=w26)
  call "niUSRP Configure Signal.gvi"(session handle=w25, IQ rate=$"IQ rate", carrier frequency=$"carrier frequency", gain=$"gain Tx", error in=w26, active antenna=$"active antenna Tx") -> (session handle out=w27, error out=w28)
  while {
    call "niUSRP Write Tx Data (CDB).gvi"(session handle=w27, data=w21, error in=w28) -> (session handle out=w29, error out=w30)
    stop if $"stop Tx"
  }
  call "niUSRP Close Session.gvi"(session handle=w29, error in=w30)
